# Grasshopper definition GH component block out.gh (Grasshopper 0.9.75)

# ---- group: Basic Material
c_script = CSharpScript()

# ----
mesh = Mesh()

# ---- group: Geometry
c_script_2 = CSharpScript(Meshes=mesh, Object_Material=c_script)

# ----
path = FilePath()

# ---- group: Scene Compiler
c_script_3 = CSharpScript(Write=Toggle(False), FilePath=path, Geometry=c_script_2)
