# Grasshopper definition line tester.gh (Grasshopper 0.9.75)
# plug-ins: GHva3c

crv = Curve([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])
divide = DivideCurve(Curve=crv, Count=Slider(1, range=1..100), Kinks=False)  # -> Points, Tangents, Parameters
bang = ExplodeTree(Data=divide.Points)  # -> Branch0, Branch1
ln = Line(StartPoint=bang.Branch0, EndPoint=bang.Branch1)
va3c_linebasicmaterial = Va3c_LineBasicMaterial(Color=ColourSwatch(SwatchColor=RGB(255, 15, 255)), LineWeight=Slider(1.9, range=0..10))
va3c_line = Va3c_Line(Line=ln)
panel = Panel(va3c_line)
panel_2 = Panel(va3c_linebasicmaterial)
va3c_scenecompiler = Va3c_SceneCompiler(
    Write=Toggle(False),
    FilePath="C:\Users\BHowes\Desktop\va3cLinesTester_004.json",
    Lines=va3c_line,
    LineMaterials=va3c_linebasicmaterial)  # -> Message, JsonPresentationOfScene
panel_3 = Panel(va3c_scenecompiler.JsonPresentationOfScene)
