# Grasshopper definition mesh tester 2.gh (Grasshopper 0.9.75)
# plug-ins: GHva3c, LunchBox

number_slider = Slider(1801, range=0..10000)
multiplication = Multiplication(A=number_slider, B=Slider(1.5, range=1..3))
klein = KleinSurface(
    UDivisions=96,
    VDivisions=91,
    RParameter=3,
    TParameter=0.5,
    Scale=number_slider,
    Domain1=Domain(0, 12.56637061),
    Domain2=Domain(0, 3.141592654))
panel = Panel("""Jonatan
Charlie
Ben""")
panel_2 = Panel("""true
1123
3.142""")
Z = UnitZ(Factor=multiplication)
move = Move(Geometry=klein, Motion=Z)  # -> Geometry, Transform
mesh_uv = MeshSurface(Surface=move.Geometry, UCount=Slider(100, range=0..100), VCount=Slider(30, range=0..100), Overhang=True, Equalize=False)
tri = Triangulate(Mesh=mesh_uv)  # -> Mesh, Count
va3c_geometry = Va3c_geometry(Mesh=tri.Mesh, AttributeNames=panel, AttributeValues=panel_2)
creatematerial = CreateMaterial(Color=ColourSwatch(SwatchColor=RGB(255, 0, 255)))
va3c_scenecompiler = Va3c_SceneCompiler(
    Write=Toggle(False),
    FilePath="C:\Users\bhowes\Desktop\DrCyanKlein.json",
    Meshes=va3c_geometry,
    MeshMaterials=creatematerial)  # -> Message, JsonPresentationOfScene
panel_3 = Panel(va3c_scenecompiler.Message)
