# Grasshopper definition mesh tester.gh (Grasshopper 0.9.75)
# plug-ins: MeshEdit Components, GHva3c

series = Series(Start=0, Step=1, Count=10)
msphere = MeshSphere(Base=PlaneXY(0, 0, 0), Radius=series, UCount=3, VCount=3)
triangulate = MeshTriangulate(Mesh=msphere, ShortDiagonal=True)
va3c_geometry = Va3c_geometry(Mesh=triangulate, MaterialNames="h")
panel = Panel(va3c_geometry)
